test file "Conceptual design phase"

suite "Model linearization"

  case "Linearization test 1" [baseline]
    model plant_VV_l, harness plant_VV_l_Harness
    signal scenario: Doublet_T (plant_VV_l_Harness/Signal Editor)
    baseline "linarization_baseline_1.mat": rel tol 0.001
      Xe:1
      Ve:1
      Att:1
      Omega:1

  case "Linearization test 2" [baseline]
    model plant_VV_l, harness plant_VV_l_Harness, stop time 5
    signal scenario: Doublet_Mx (plant_VV_l_Harness/Signal Editor)
    baseline "linarization_baseline_2.mat": rel tol 0.001
      Xe:1: rel tol 0.005
      Ve:1: rel tol 0.005
      Att:1
      Omega:1

  case "Linearization test 3" [baseline]
    model plant_VV_l, harness plant_VV_l_Harness, stop time 5
    signal scenario: Doublet_My (plant_VV_l_Harness/Signal Editor)
    baseline "linarization_baseline_3.mat": rel tol 0.001
      Xe:1: rel tol 0.005
      Ve:1: rel tol 0.005
      Att:1
      Omega:1

  case "Linearization test 4" [baseline]
    model plant_VV_l, harness plant_VV_l_Harness
    signal scenario: Doublet_Mz (plant_VV_l_Harness/Signal Editor)
    baseline "linarization_baseline_4.mat": rel tol 0.001
      Xe:1
      Ve:1
      Att:1
      Omega:1

suite "Requirements verification"

  suite "Re-GNC-Prelim-01"
    description: The drone control system shall be robust

    case "Re-GNC-Prelim-01.1" [simulation]
      description: The gain margin for the angular velocity feedback loop shall be infinite
      model plant_control_1, harness plant_control_1_Harness1

    case "Re-GNC-Prelim-01.2" [simulation]
      description: The gain margin for the attitude feedback loop shall be infinite
      model plant_control_2, harness plant_control_2_Harness1

    case "Re-GNC-Prelim-01.3" [simulation]
      description: The gain margin for the velocity feedback loop shall be more than 100dB
      model plant_control_3, harness plant_control_3_Harness1

    case "Re-GNC-Prelim-01.4" [simulation]
      description: The gain margin for the velocity feedback loop shall be more than 25dB
      model plant_control_4, harness plant_control_4_Harness1

  suite "Re-GNC-Prelim-02"
    description: The drone control system shall have a desirable performance

    case "Re-GNC-Prelim-02.1" [simulation]
      description: The cross-over frequency for the angular velocity feedback loop shall be 25 rad/s (+- 1%)
      model plant_control_1
      custom criteria:
        TF=tf(sltest_simout.sys1_1.values);
        [~,~,~,Wcp] = margin(TF);

        test.verifyEqual(Wcp,25,"The cross-over frequency for the angular velocity feedback loop shall be 25 rad/s (+- 1%)","RelTol",0.01);

    case "Re-GNC-Prelim-02.2" [simulation]
      description: The cross-over frequency for the attitude feedback loop shall be 10 rad/s (+- 1%)

    case "Re-GNC-Prelim-02.3" [simulation]
      description: The cross-over frequency for the velocity feedback loop shall be 10 rad/s (+- 1%)

    case "Re-GNC-Prelim-02.4" [simulation]
      description: The cross-over frequency for the position feedback loop shall be 1 rad/s (+- 5%)

    case "Re-GNC-Prelim-02.5" [simulation]
      description: The angular velocity feedback loop shall have 0% overshoot

    case "Re-GNC-Prelim-02.6" [simulation]
      description: The attitude feedback loop shall have less than 10% overshoot

    case "Re-GNC-Prelim-02.7" [simulation]
      description: The velocity feedback loop shall have less than 10% overshoot

    case "Re-GNC-Prelim-02.8" [simulation]
      description: The position feedback loop shall have less than 10% overshoot

    case "Re-GNC-Prelim-02.9" [simulation]
      description: The drone shall not pitch more than 60 deg
      model plant_control, harness plant_control_Harness1
      custom criteria:
        data=find(sltest_simout.yout, "pitch").Values.Data;
        max_data=max(data);
        test.assertLessThan(max_data, 60, "The pitch angle has to be less than 60deg.")

    case "Re-GNC-Prelim-02.10" [simulation]
      description: The drone shall not roll more than 60 deg
      model plant_control, harness plant_control_Harness1
      custom criteria:
        data=find(sltest_simout.yout, "roll").Values.Data;
        max_data=max(data);
        test.assertLessThan(max_data, 60, "The roll angle has to be less than 60deg.")

  suite "Re-GNC-Prelim-03"
    description: The control system shall be stable

    case "Re-GNC-Prelim-03.1" [simulation]
      description: The angular velocity feedback loop shall have positive gain margins
      model plant_control_1, harness plant_control_1_Harness1

    case "Re-GNC-Prelim-03.2" [simulation]
      description: The attitude feedback loop shall have positive gain margins
      model plant_control_2, harness plant_control_2_Harness1

    case "Re-GNC-Prelim-03.3" [simulation]
      description: The velocity feedback loop shall have positive gain margins
      model plant_control_3, harness plant_control_3_Harness1

    case "Re-GNC-Prelim-03.4" [simulation]
      description: The position feedback loop shall have positive gain margins
      model plant_control_4, harness plant_control_4_Harness1